# Grasshopper definition parametric pods.gh (Grasshopper 1.0.7)

number_slider = Slider(5, range=0..100)
yz = YZPlane(Origin=Point(0, 0, 0))
recgrid = Rectangular(
    Plane=yz,
    SizeX=Slider(5, range=0..100),
    SizeY=number_slider,
    ExtentX=Slider(15, range=0..100),
    ExtentY=Slider(5, range=0..100))  # -> Cells, Points
multiplication = Multiplication(A=".5", B="2")
subtraction = Subtraction(A=number_slider, B=multiplication)
X = UnitX(Factor=subtraction)
neg = Negative(Value=X)
neg_2 = Negative(Value=".5")
offset = OffsetCurve(Curve=recgrid.Cells, Distance=neg_2, Plane=yz, Corners=1)
extr = Extrude(Base=offset, Direction=neg)
crv = Curve(offset)
flatten = FlattenTree(Tree=crv, Path="{0}")
boundary = BoundarySurfaces(Edges=offset)
area = Area(Geometry=flatten)  # -> Area, Centroid
sunion = SolidUnion(Breps=[extr, boundary])
debrep = DeconstructBrep(Brep=sunion)  # -> Faces, Edges, Vertices
pt = Point(Point(4.40781865, 63.38806592, 12.51028297))
ln = Line(StartPoint=area.Centroid, EndPoint=pt)
item = ListItem(List=debrep.Faces, Index=Slider(2, range=0..6), Wrap=True)
item_2 = ListItem(List=debrep.Faces, Index=Slider(4, range=0..6), Wrap=True)
area_2 = Area(Geometry=item)  # -> Area, Centroid
area_3 = Area(Geometry=item_2)  # -> Area, Centroid
number_slider_2 = Slider(76, range=0..100)
ln_2 = Line(StartPoint=area_2.Centroid, EndPoint=area_3.Centroid)
flatten_2 = FlattenTree(Tree=sunion, Path="{0}")
number_slider_3 = Slider(180, range=0..360)
number_slider_4 = Slider(0, range=0..360)
flatten_3 = FlattenTree(Tree=ln_2, Path="{0}")
item_3 = ListItem(List=flatten(ln_2), Index=number_slider_2, Wrap=True)
item_4 = ListItem(List=flatten(flatten_2), Index=number_slider_2, Wrap=True)
brep = Brep(item_4)
crv_2 = Curve(item_3)
bnd = Bounds(Numbers=ln)
dom = ConstructDomain(DomainStart=number_slider_3, DomainEnd=number_slider_4)
remap = RemapNumbers(Value=ln, Source=bnd, Target=dom)  # -> Mapped, Clipped
graph = GraphMapper(remap.Mapped, x0=0, x1=1, y0=0, y1=1, A=1, B=0, container_name="Linear")
rotate = Rotate(Geometry=flatten_2, Angle=degrees(graph), Plane=flatten_3)  # -> Geometry, Transform
gradient = Gradient(LowerLimit=number_slider_3, UpperLimit=number_slider_4, Parameter=graph, stops=[0: RGB(255, 255, 255), 1: RGB(0, 0, 0)])
preview = CustomPreview(Geometry=rotate.Geometry, Material=gradient)
